# Dynamo graph Structural-Pile_Cap_Location_And_Offset.dyn "Structural-Pile_Cap_Location" (Dynamo 2.5.0.7460)
# packages: Clockwork for Dynamo 2.x 2.3.0

# group: USER INTERFACE
# note: User Input

# group: BACKEND PROCESS - GET STRUCTURAL DATA --> EXPORT DATA
# note: 1. GETS STRUCTURAL DATA
# 2. FILTERS DATA FOR REQUIRED COLUMNS FOR MAPPING OF SPECIFIED COLUMN TYPES AT SPECIFIC LEVEL
# 3. GETS COLUMN COORDINATE DATA TO USE FOR PILE CAP MAPPING
# 4. EXPORTS REQUIRED COLUMN DATA TO EXCEL

# group: BACKEND PROCESS - PILE CAP GET DATA --> EXPORT DATA
# note: 1. GETS STRUCTURAL FOUNDATION DATA
# 2. FILTERS DATA FOR REQUIRED PILE CAP MAPPING
# 3. GETS PILE CAP COORDINATE DATA TO USE FOR PILE CAP MAPPING
# 4. EXPORTS REQUIRED PILE CAP DATA TO EXCEL

# group: PILE CAP - GRID LOCATION & ELEVATION
# note: NOTES:
# 1. Uses pile cap associated column to get grid location mark.
# 2. T.O. pile cap elevation (offset) exported as grading varies.
# 3. User to select target file path.
# 4. After script run complete, user to copy export data from Dynamo_Export sheet to Pile Cap sheet for distribution and auto clean-up

# group: Backend Process - Pile Cap To Column
# note: BACKEND PROCESS - MAPPING PILE CAP TO ASSOCIATED COLUMN USING CENTERLINE COORDINATES

# group: User Input
# note: SELECT TARGET EXCEL FILE FOR EXPORTING DATA - CHECK BEFORE EVERY RUN
file_path = Filename(".\Pile_Cap-Type&Location-Schedule.xlsx")

# group: User Input
# note: USER TO INPUT ANY CHANGE PARAMETERS IN GREEN HIGHLIGHTED GROUP
# note: TARGET SHEET NAME
# note: PILE CAP MODEL CATEGORY
# note: COLUMN TYPE MODEL CATEGORY
code_block = CodeBlock { "Dynamo_Export"; 1; 0; false; "OST_StructuralFoundation"; "OST_StructuralColumns"; }

# group: Backend Process - Get Data
# note: GETS ALL ELEMENTS TO LIST OF  FOUNDATION CATEGORY
byName = Category.ByName(name=code_block.out4)
all_elements_of_category = ElementsOfCategory(Category=byName)

# group: User Control/Backend Process - Cleans Data Per Pile Cap Type
# note: USER REQUIRED TO CHECK BEFORE EACH RUN - GETS ALL PILE CAPS BY SEARCH STRING SPECIFIED BY USER
string_from_object = FromObject(obj=all_elements_of_category)
string = StringInput("PC")  # graph input
contains = String.Contains(str=string_from_object, searchFor=string)
# note: NOTE:
# 1. PER PROJECT, PILE CAP NAMING MAY DIFFER SO MAY NEED TO MODIFY SEARCH STRING
filterByBoolMask = List.FilterByBoolMask(list=all_elements_of_category, mask=contains)

# group: User Input
# note: SET COLUMN BASE REFERENCE LEVEL - CHECK BEFORE EVERY RUN
levels = Levels("T. O. FOUNDATION")  # graph input
all_elements_at_level = ElementsAtLevel(Level=levels)

# group: Backend Process - Get Data
# note: GETS ALL ELEMENTS AT INPUTTED LEVEL AND FILTERS TO CREATE LIST OF ONLY ELMENTS OF COLUMN CATEGORY
byName_2 = Category.ByName(name=code_block.out5)
isOfCategory = Custom[Element.IsOfCategory](element=all_elements_at_level, category=byName_2)  # package Clockwork for Dynamo 2.x; Checks whether an element is of a specified category
filterByBoolMask_2 = List.FilterByBoolMask(list=all_elements_at_level, mask=isOfCategory)

# group: User Control/Backend Process - Cleans Data Per Column Type
# note: USER REQUIRED TO CHECK BEFORE EACH RUN THAT CORRECT COLUMN TYPES ARE SELECTED TO AQUIRE REQUIRED DATA (I.E. GRID LOCATION MARK)
# note: PER  PROJECT:
# CONCRETE SYSTEM VS. STEEL SYSTEM
string_from_object_2 = FromObject(obj=filterByBoolMask_2.in)
string_2 = StringInput("W")  # graph input
# note: STEEL - WIDE FLANGE TYPE
contains_2 = String.Contains(str=string_from_object_2, searchFor=string_2)
# note: NOTE:
# 1. MAY NEED TO CREATE NEW SEARCH TYPE OR MODIFY PER PROJECT TYPE NAMING CONVENTION
# 2. CAREFUL FOR DUPLICATES (E.G. MODELING CONCRETE ENCASEMENT AS A CONCRETE COLUMN)
filterByBoolMask_3 = List.FilterByBoolMask(list=filterByBoolMask_2.in, mask=contains_2)
string_from_object_3 = FromObject(obj=filterByBoolMask_2.in)
string_3 = StringInput("HSS")  # graph input
# note: STEEL - HSS TYPE
contains_3 = String.Contains(str=string_from_object_3, searchFor=string_3)
filterByBoolMask_4 = List.FilterByBoolMask(list=filterByBoolMask_2.in, mask=contains_3)
string_from_object_4 = FromObject(obj=filterByBoolMask_2.in)
string_4 = StringInput("BUILT")  # graph input
# note: STEEL - BUILT-UP HSS TYPE
contains_4 = String.Contains(str=string_from_object_4, searchFor=string_4)
filterByBoolMask_5 = List.FilterByBoolMask(list=filterByBoolMask_2.in, mask=contains_4)
join = List.Join(list0=filterByBoolMask_3.in, list1=filterByBoolMask_4.in, list2=filterByBoolMask_5.in)
string_from_object_5 = FromObject(obj=filterByBoolMask_2.in)
string_5 = StringInput("CE")  # graph input
# note: CONCRETE - RECTANGULAR ENCASEMENT TYPE
contains_5 = String.Contains(str=string_from_object_5, searchFor=string_5)
filterByBoolMask_6 = List.FilterByBoolMask(list=filterByBoolMask_2.in, mask=contains_5)

# group: REQUIRED DATA/BACKEND PROCESS - GET EACH COLUMN COORDINATES
# note: COLUMN LOCATION BY CARTESIAN COORDINATES (COLUMN C.L.) - USED TO MATCH WITH PILE CAP COORDINATES
# note: CLOCKWORK PACKAGE
location = Custom[Element.Location](element=join)  # package Clockwork for Dynamo 2.x; Returns the location of an element as point, curve or curve loop, along with some booleans to help filtering the results. Unlike the OOTB Element.GetLocation node, it also retunrs sketch lines of sketch-based elements like floor slabs as well as the element's rotation property.
X = Point.X(point=location.points)
Y = Point.Y(point=location.points)
# note: CONSOLIDATES X & Y COORDINATES
byCoordinates = Point.ByCoordinates(x=X, y=Y)
string_from_object_6 = FromObject(obj=byCoordinates)

# group: BACKEND PROCESS - GET EACH PILE CAP COORDINATES
# note: Clockwork Package
# note: PILE CAP LOCATION BY CARTESIAN COORDINATES (CENTER OF MASS) - USED TO MATCH WITH COLUMN COORDINATES
location_2 = Custom[Element.Location](element=filterByBoolMask.in)
X_2 = Point.X(point=location_2.points)
Y_2 = Point.Y(point=location_2.points)
byCoordinates_2 = Point.ByCoordinates(x=X_2, y=Y_2)
string_from_object_7 = FromObject(obj=byCoordinates_2)
indexOf = List.IndexOf(list=string_from_object_7)  # unwired: element

# group: Backend Process - Map Pile Cap to Column
# note: PILE CAP TO COLUMN MAPPING USING CARTESION (X,Y) COORDINATES - COORDINATES ARE OF TYPE STRING
map = List.Map(list=string_from_object_6, f_x=indexOf)
# note: MONITOR MATCHING COLUMN COORDINATE LIST INDEX
watch = Watch(map)

# group: Backend Process - No Match Condition
# note: IF NO MATCHING PILE CAP FOUND, REPLACE -1 WITH BLANK STRING ("")
code_block_2 = CodeBlock { ""; }
code_block_3 = CodeBlock { -1; }
eq = code_block_3 == _  # unwired: y
replaceByCondition = Replace(item=watch, replaceWith=code_block_2, condition=eq)

# group: REQUIRED DATA - PILE CAP NAME
# note: 1. RE-ORGANIZES PILE CAP LIST TO MAPPED "PILE CAP TO COLUMN" - ASSOCIATES BY INDEX
create = List.Create(item0=filterByBoolMask.in)
transpose = List.Transpose(lists=create)
# note: MAPS PILE CAP TO ASSOCIATED COLUMN BY MATCHED INDEX
code_block_4 = CodeBlock(pioints=transpose, x=replaceByCondition) { pioints[x]; }
# note: LIST OF LISTS - GETS ITEM AT INDEX 0 OF OVERALL LIST
code_block_5 = CodeBlock { 0; }
getItemAtIndex = List.GetItemAtIndex(index=code_block_5)  # unwired: list
# note: CONSOLIDATES PILE CAP LIST OF LISTS TO ONE LIST
map_2 = List.Map(list=code_block_4, f_x=getItemAtIndex)

# group: REQUIRED DATA - PILE CAP TYPE NAME
# note: IF NO PILE CAP MATCH (DUE TO MAT FOUNDATION) REPLACE PILE CAP WITH NO MATCH
code_block_6 = CodeBlock { "NO MATCH"; }
isNull = Object.IsNull()  # unwired: obj
replaceByCondition_2 = Replace(item=map_2, replaceWith=code_block_6, condition=isNull)

# group: REQUIRED DATA - GRID LINE INTERSECT (COLUMN LOCATION MARK)
# note: ACQUIRE LIST OF COLUMN GRIDLINE INTERSECTION
string_6 = StringInput("Column Location Mark")  # graph input
getParameterValueByName = Element.GetParameterValueByName(element=join, parameterName=string_6)

# group: REQUIRED DATA - OFFSET FROM REFERENCE LEVEL
# note: CALCULATE PILE CAP OFFSET FROM USER SPECIFIED REFERENCE LEVEL
location_3 = Custom[Element.Location](element=map_2)
Z = Point.Z(point=location_3.points)
elevation = Level.Elevation(level=levels)
code_block_7 = CodeBlock(x=Z, y=elevation) { x-y; }

# group: REQUIRED DATA - OFFSET FROM SEA LEVEL DATUM
code_block_8 = CodeBlock { "Elevation at Top"; }
# note: ACQUIRES PILE CAP OFFSET DATA FROM GRADE (ELEVATION FROM SEA LEVEL)
getParameterValueByName_2 = Element.GetParameterValueByName(element=map_2, parameterName=code_block_8)

# group: REQUIRED DATA - ASSOCIATED COLUMN FAMILY & TYPE NAME
# note: ACQUIRE COLUMN FAMILY NAME & TYPE
elementType = Element.ElementType(element=join)
name = Family.Name(family=elementType)
family = FamilyType.Family(familyType=elementType)

# group: Backend Process - Consolidate Export Info to List
# note: CONSOLIDATE EXPORT INFO - PILE CAP, GRIDLINE INTERSECT, OFFSET FROM REFERENCE LEVEL AS LIST OF LISTS
create_2 = List.Create(item0=replaceByCondition_2, item1=getParameterValueByName, item2=code_block_7, item3=getParameterValueByName_2, item4=X, item5=Y, item6=name, item7=family)
transpose_2 = List.Transpose(lists=create_2)

# group: OUTPUT TO EXCEL
# note: CONSILDATES DATA AND WRITES TO TARGET EXCEL FILE
exportExcel = Data.ExportExcel(filePath=file_path, sheetName=code_block.out0, startRow=code_block.out1, startCol=code_block.out2, data=transpose_2, overWrite=code_block.out3)
# note: MONITOR FOR EACH ROW OUTPUT
watch_2 = Watch(exportExcel)

# group: Monitor for Desired Output
# note: Lists Available Pile Cap Parameters for Output
parameters = Element.Parameters(element=all_elements_of_category)
watch_3 = Watch(parameters)
